# Grasshopper definition LeafGenerator.gh (Grasshopper 1.0.8)
# plug-ins: GH_MCP

Z = Slider(29000, range=0..30000)
X = Slider(0, range=-5000..5000)
Y = Slider(0, range=-5000..5000)
height_total_m = Slider(14, range=5..15)
landing_radius_m = Slider(1.2, range=0.5..3)
twist_total_deg = Slider(60, range=-180..180)
flow_rate_lpm = Slider(45, range=10..100)
grasshopper_mcp = GrasshopperMCP(Enabled=True, Port=8080)  # -> Status, LastCommand
nozzle_azimuth_deg = Slider(0, range=-180..180)
nozzle_tile_deg = Slider(0, range=0..60)
construct_point = ConstructPoint(XCoordinate=X, YCoordinate=Y, ZCoordinate=Z)
build = Python3Script(
    height_total_m=height_total_m,
    landing_radius_m=landing_radius_m,
    twist_total_deg=twist_total_deg,
    candidate_id="cand_phaseb_e2e",
    nozzle_points=construct_point,
    flow_rate_lpm=flow_rate_lpm,
    nozzle_tilt_deg=nozzle_tile_deg,
    nozzle_azimuth_deg=nozzle_azimuth_deg)  # -> out, a, b, c, d; inputs height_total_m: Double, landing_radius_m: Double, twist_total_deg: Double, candidate_id: String, nozzle_points: list of Point3d, flow_rate_lpm: Double, nozzle_tilt_deg: Double, nozzle_azimuth_deg: Double
# ---------- build: Python ----------
# r: trimesh
import sys, pathlib, json, importlib
import Rhino
import Rhino.Geometry as rg

REPO_ROOT = pathlib.Path(r"C:\Users\user\Documents\LFTH_CFD")
if str(REPO_ROOT) not in sys.path:
    sys.path.insert(0, str(REPO_ROOT))

# hot-reload — picks up gh/scripts/*.py edits without Rhino restart
import gh.scripts.leaf_generator
import gh.scripts.water_curtain
importlib.reload(gh.scripts.leaf_generator)
importlib.reload(gh.scripts.water_curtain)
from gh.scripts.leaf_generator import build_real_leaf_mesh, build_params_dict
from gh.scripts.water_curtain import (
    nozzles_from_points, fall_trajectory_endpoint, velocity_from_tilt,
)

doc = Rhino.RhinoDoc.ActiveDoc
m_to_doc = Rhino.RhinoMath.UnitScale(Rhino.UnitSystem.Meters, doc.ModelUnitSystem)
m_to_doc = m_to_doc if m_to_doc != 0 else 1.0
doc_to_m = 1.0 / m_to_doc

verts, faces = build_real_leaf_mesh(height_total_m, landing_radius_m, twist_total_deg)

# doc-unit Points → meters
points_xyz = [(p.X * doc_to_m, p.Y * doc_to_m, p.Z * doc_to_m) for p in nozzle_points]

# tilt-driven initial velocity (shared across all nozzles); fall_height
# is read from build_params_dict default (15 m) since it's not a slider.
fall_h_default = 15.0
velocity_shared = velocity_from_tilt(
    fall_height_m=fall_h_default,
    tilt_deg=nozzle_tilt_deg,
    azimuth_deg=nozzle_azimuth_deg,
)
nozzles = nozzles_from_points(
    points_xyz, flow_rate_lpm, velocity_mps_shared=velocity_shared
)

params_dict = build_params_dict(
    candidate_id, height_total_m, landing_radius_m, twist_total_deg, nozzles=nozzles
)
fall_h = params_dict["water"]["fall_height_m"]

# Rhino preview mesh - meter→doc scale
mesh = rg.Mesh()
for v in verts:
    mesh.Vertices.Add(v[0] * m_to_doc, v[1] * m_to_doc, v[2] * m_to_doc)
for f in faces:
    mesh.Faces.AddFace(f[0], f[1], f[2])
mesh.Normals.ComputeNormals()
mesh.Compact()

# Free-fall preview lines (one per nozzle, meter→doc scale).
# Parabolic endpoint when nozzle_tilt_deg > 0.
curtain_curves = []
for nz in nozzles:
    sp_m = tuple(nz["position"])
    vel = tuple(nz["velocity_mps"]) if nz["velocity_mps"] is not None else None
    ep_m = fall_trajectory_endpoint(sp_m, fall_h, velocity_mps=vel)
    sp = rg.Point3d(sp_m[0] * m_to_doc, sp_m[1] * m_to_doc, sp_m[2] * m_to_doc)
    ep = rg.Point3d(ep_m[0] * m_to_doc, ep_m[1] * m_to_doc, ep_m[2] * m_to_doc)
    curtain_curves.append(rg.Line(sp, ep).ToNurbsCurve())

a = mesh
b = json.dumps(params_dict)
c = candidate_id
d = curtain_curves
# ---------- end build ----------
reference = Geometry([<mesh referenced from the Rhino model> x24])
panel = Panel(build.d)
export = Python3Script(mesh=build.a, params_dict=build.b, candidate_id=build.c)  # -> out, a; inputs mesh: Mesh, candidate_id: String
# ---------- export: Python ----------
# r: trimesh
import sys, pathlib, json, importlib
import Rhino

REPO_ROOT = pathlib.Path(r"C:\Users\user\Documents\LFTH_CFD")
if str(REPO_ROOT) not in sys.path:
    sys.path.insert(0, str(REPO_ROOT))

# hot-reload
import gh.scripts.export_candidate
importlib.reload(gh.scripts.export_candidate)
from gh.scripts.export_candidate import export_candidate

doc = Rhino.RhinoDoc.ActiveDoc
m_to_doc = Rhino.RhinoMath.UnitScale(Rhino.UnitSystem.Meters, doc.ModelUnitSystem)
m_to_doc = m_to_doc if m_to_doc != 0 else 1.0
doc_to_m = 1.0 / m_to_doc

params_dict = json.loads(params_dict)

verts = []
for v in mesh.Vertices:
    verts.append((v.X * doc_to_m, v.Y * doc_to_m, v.Z * doc_to_m))
faces = []
for f in mesh.Faces:
    if f.IsQuad:
        faces.append((f.A, f.B, f.C))
        faces.append((f.A, f.C, f.D))
    else:
        faces.append((f.A, f.B, f.C))

out_dir = REPO_ROOT / "runs" / candidate_id
summary = export_candidate(verts, faces, params_dict, out_dir)

a = "OK | {} | tri={} | vert={}".format(
    summary["stl_path"], summary["triangle_count"], summary["vertex_count"]
)
# ---------- end export ----------
panel_2 = Panel(export.a)
